# Dynamo graph CreateWalls.dyn (Dynamo 2.3.0.5885)

code_block = CodeBlock { 25; 25; }
levels = Levels("1ST FFL")
create_walls_python = Python(IN[0]=code_block.out0, IN[1]=code_block.out1, IN[2]=levels)
# ---------- create_walls_python.python (48 lines) ----------
# Load the Python Standard and DesignScript Libraries
import sys
import clr

clr.AddReference('RevitNodes')
from Revit.Elements import *

import Revit
clr.ImportExtensions(Revit.Elements)

clr.AddReference("RevitServices")
import RevitServices
from RevitServices.Persistence import DocumentManager
from RevitServices.Transactions import TransactionManager
doc = DocumentManager.Instance.CurrentDBDocument

clr.AddReference('RevitAPI')
from Autodesk.Revit.DB import XYZ, Line, Wall

width = IN[0]
height = IN[1]
level = UnwrapElement(IN[2])

pt1 = XYZ(0, 0, 0)
pt2 = XYZ(width, 0, 0)
pt3 = XYZ(width, height, 0)
pt4 = XYZ(0, height, 0)

pts = [pt1, pt2, pt3, pt4]
walls = []

# Transaction 시작
TransactionManager.Instance.EnsureInTransaction(doc)

for n, pt in enumerate(pts):
	try:
		wall_line = Line.CreateBound(pt, pts[n+1])
	except IndexError:
		wall_line = Line.CreateBound(pt, pts[0])
	wall = Wall.Create(doc, wall_line, level.Id, False)
	walls.append(wall.ToDSType(False))

# Transaction 종료
TransactionManager.Instance.TransactionTaskDone()

OUT = walls

	
# ----------------------------------------
watch = Watch(create_walls_python)
geometry = Element.Geometry(element=watch)
